# Grasshopper definition element_obj_export.gh (Grasshopper 1.0.7)

python = PythonScript()  # -> gh_doc_dir
# ---------- python: Python ----------
import scriptcontext as sc
from os import path

rhino_doc_dir = path.abspath(path.dirname(sc.doc.Path))
# ---------- end python ----------
brep = Brep([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])
export_obj = BooleanToggle(False)
mesh = Mesh(brep)
ghpython_script = GhPythonScript(meshes=mesh, file_path=python, write=export_obj)  # -> out, a; inputs meshes: list of Mesh
# ---------- ghpython_script: Python ----------
import rhinoscriptsyntax as rs
import Rhino.Geometry as rg
#import Rhino.Geometry.Plane as Plane
#import Rhino.Geometry.Point3d as Point3d
#import Rhino.Geometry.Vector3d as Vector3d
#import Rhino.Geometry.Quaternion as Quat
import Grasshopper.DataTree as DataTree # Add, AddRange(list, GHPath(i, j))
import Grasshopper.Kernel.Data.GH_Path as GHPath
import System

from ghpythonlib.treehelpers import list_to_tree, tree_to_list
import os
#import json
#from compas.geometry import Frame
#from compas_ghpython import draw_pipes, draw_frame

from compas.datastructures import Mesh

def rMesh2cMesh(rg_mesh):
    if type(rg_mesh) == rg.Mesh:
        #single mesh
        compas_mesh_vertices = rg_mesh.Vertices.ToPoint3dArray()
        compas_mesh_faces = rg_mesh.Faces.ToIntArray(True)
        compas_mesh_faces = [compas_mesh_faces[i:i + 3] for i in range(0, len(compas_mesh_faces), 3)]
        return Mesh.from_vertices_and_faces(compas_mesh_vertices, compas_mesh_faces)
    else:
        raise NotImplementedError()
        
# we use compas Mesh to export each element into a obj file
for i, mesh in enumerate(meshes):
    cm = rMesh2cMesh(mesh)
    if write:
        cm.to_obj(os.path.join(file_path, 'element_{}.obj'.format(i)))
# ---------- end ghpython_script ----------
panel = Panel(python)
